# Grasshopper definition test.ghx (Grasshopper 1.0.7)

pt = Point(<point referenced from the Rhino model>)
series = Series(Start=0, Step=Slider(5000, range=0..10000), Count=Slider(10, range=0..10))
Z = UnitZ(Factor=series)
move = Move(Geometry=pt, Motion=Z)  # -> Geometry, Transform
series_2 = Series(Start=0, Step=Slider(93, range=0..10000), Count=Slider(10, range=0..10))
pt_2 = Point(move.Geometry)
sph = Sphere(Base=pt_2, Radius=series_2)
